# Dynamo graph Prueba 1.dyn (Dynamo 2.19.3.6394)

wall_types = WallTypes("Muro Prueba Dynamo")
string = StringInput("Type Mark")
getParameterValueByName = Element.GetParameterValueByName(parameterName=string)  # unwired: element
sortByFunction = List.SortByFunction(list=wall_types, sortFunction=getParameterValueByName)
string_2 = StringInput("EnergyPlus_Zone")
file_path = Filename("C:\Users\user\Documents\Prueba.xlsx")
file_from_path = FileObject(path=file_path)
string_3 = StringInput("1")
importExcel = Data.ImportExcel(file=file_from_path, sheetName=string_3)
wall_types_2 = WallTypes("Muro Prueba Dynamo")
python_script = Python(IN[0]=importExcel, IN[1]=wall_types_2)  # CPython3; graph output
# ---------- python_script.python (107 lines) ----------
import clr
import re

clr.AddReference('RevitAPI')
from Autodesk.Revit.DB import *

clr.AddReference('RevitServices')
import RevitServices
from RevitServices.Persistence import DocumentManager
from RevitServices.Transactions import TransactionManager

doc = DocumentManager.Instance.CurrentDBDocument

# --- ENTRADAS DE DYNAMO ---
data_rows = IN[0]          
base_wall_type = UnwrapElement(IN[1]) 
param_name = "EnergyPlus_Zone" 

def cm_to_feet(cm):
    return cm / 30.48

def get_material_id(name):
    collector = FilteredElementCollector(doc).OfClass(Material)
    for m in collector:
        if m.Name.lower().strip() == name.lower().strip():
            return m.Id
    return None

# 1. ORGANIZACIÓN DE DATOS
strategy_map = {} # Todas las composiciones para crear el catálogo
top1_map = {}     # Relación Zona -> Estrategia Ganadora (Ranking 1)

for row in data_rows[1:]:
    if len(row) >= 9:
        # Limpieza profunda de los nombres del Excel
        zone_name = str(row[0]).strip().lower()
        # Convertimos ranking a string y quitamos decimales si los hay (ej: "1.0" -> "1")
        ranking = str(row[1]).split('.')[0].strip() 
        s_id = str(row[2]).strip()
        comp = str(row[8]).strip()
        
        # Guardar para creación de tipos
        if s_id not in strategy_map:
            strategy_map[s_id] = comp
            
        # Asignar como ganador si el ranking es 1
        if ranking == "1":
            top1_map[zone_name] = s_id

# --- INICIAR TRANSACCIÓN ---
TransactionManager.Instance.EnsureInTransaction(doc)

created_types = {}
all_wall_types = FilteredElementCollector(doc).OfClass(WallType).ToElements()

# 2. CREAR O BUSCAR TIPOS DE MURO
for s_id, comp in strategy_map.items():
    # Buscar si ya existe por nombre exacto
    existing = next((wt for wt in all_wall_types if wt.get_Parameter(BuiltInParameter.SYMBOL_NAME_PARAM).AsString() == s_id), None)
    
    if existing is None:
        try:
            new_type = base_wall_type.Duplicate(s_id)
            layers = []
            for p in comp.split('|'):
                parts = p.strip().split('_')
                mat_name = "_".join(parts[:-1])
                # Extraer grosor eliminando 'cm' y convirtiendo a float
                thick_val = float(re.findall(r"[-+]?\d*\.\d+|\d+", parts[-1])[0])
                m_id = get_material_id(mat_name)
                if m_id:
                    layers.append(CompoundStructureLayer(cm_to_feet(thick_val), MaterialFunctionAssignment.Finish1, m_id))
            
            if layers:
                cs = new_type.GetCompoundStructure()
                cs.SetLayers(layers)
                new_type.SetCompoundStructure(cs)
            created_types[s_id] = new_type
        except: continue
    else:
        created_types[s_id] = existing

# 3. REEMPLAZO EN EL MODELO (ASIGNACIÓN)
all_walls = FilteredElementCollector(doc).OfClass(Wall).ToElements()
applied_count = 0
debug_list = []

for wall in all_walls:
    p = wall.LookupParameter(param_name)
    if p and p.HasValue:
        wall_zone = p.AsString().strip().lower()
        debug_list.append(wall_zone) # Para ver qué está leyendo Revit
        
        if wall_zone in top1_map:
            target_id = top1_map[wall_zone]
            if target_id in created_types:
                # CAMBIAR EL TIPO FÍSICO
                wall.WallType = created_types[target_id]
                applied_count += 1

TransactionManager.Instance.TransactionTaskDone()

# MENSAJE DE SALIDA
if applied_count > 0:
    OUT = "ÉXITO: Se han actualizado {} muros al Top 1.".format(applied_count)
else:
    OUT = "ERROR: No se actualizaron muros. Revisa si los nombres en Revit coinciden con: " + str(top1_map.keys())
# ----------------------------------------
setParameterByName = Element.SetParameterByName(element=sortByFunction, parameterName=string_2, value=python_script)
